# Grasshopper definition gh-ground-truth.ghx (Grasshopper 1.0.7)
# plug-ins: Docofossor

scan = GhPythonScript(activate=Toggle(False), start_proxy=Toggle(False))  # -> out, f; inputs activate: Boolean, start_proxy: Boolean
# ---------- scan: Python ----------
from compas_ghpython import unload_modules
unload_modules('groundtruth')
from compas.rpc import Proxy

#proxy=Proxy()
#proxy.stop_server()

interface = None

if activate:
    if start_proxy:
        interface = Proxy('groundtruth.interactive.interface')
    else:
        Proxy.stop_server(interface)
        
        
if interface:
    f = interface.get_height_grid()
# ---------- end scan ----------
dam = DataDam(DataA=scan.f, BufferDelay=10000000, BufferMode=0)
dfimportasc = ImportASC(F=dam)
dfgridmesh = GridMesh(Df=dfimportasc)
